vi "Aggregate Test Data.gviweb"   [LabVIEW NXG 2.0.0]
inputs:
  "Array": bool[]
  "Array_3": T1[]
  "Array_5": f64[]
  "Array_2": f64[]
  "Numeric": i32
outputs:
  "Array_4": bool[]
  "Sequence Pass/Fail": bool
  "Test Sequence Results": T1[]
types:
  T1 = cluster{"Bandwidth (MHz)": f64, "SNR": f64, "Power Consumption %": f64, "Step Pass?": bool}
diagram:
  Is Greater(x=$Numeric, y=10) -> w1
  case (w1) {
    frame True {
      w2 = $Array
      w3 = $Array_3
    }
    frame False {
      Replace Array Subset(inArray=$Array, index=$Numeric, new=TRUE) -> w2
      Random Number() -> (number (0 to 1)=w4)
      Add(100, w4) -> w5
      Array Index(array=$Array_5) -> (out0[$Numeric]=w6)
      Array Index(array=$Array_2) -> (out0[$Numeric]=w7)
      Divide(x=w6, y=w7) -> w8
      Random Number() -> (number (0 to 1)=w9)
      Add(77, w9) -> w10
      Property Node(instance in=T1 {all zero or empty}, "Bandwidth (MHz)"=w5, "SNR"=w8, "Power Consumption %"=w10, "Step Pass?"=TRUE) -> (instance out=w11)
      Insert Into Array(inArray=$Array_3, new=w11) -> w3
    }
  }
  $Array_4 <- w2
  And Array Elements(Boolean array=w2) -> (logical AND=w12)
  $"Sequence Pass/Fail" <- w12
  $"Test Sequence Results" <- w3
