vi "Main.gviweb"   [LabVIEW NXG 2.0.0]
panel controls:
  "Previous test Results": i32 = -1
  "Select Test Site": i32 = "NIWeek Keynote Stage"(0)
panel indicators:
  "Observed Data and Fitted Curve": cluster{"Element 1": f64, "Element 2": f64}[][]
  "Sequence Pass/Fail": bool
  "Test Sequence Results": T1[]
types:
  T1 = cluster{"Bandwidth (MHz)": f64, "SNR": f64, "Power Consumption %": f64, "Step Pass?": bool}
uses:
  Application::Get Tag.gviweb
diagram:
  w1 = [FALSE, FALSE, FALSE, FALSE, FALSE, FALSE, FALSE, FALSE, FALSE, FALSE, FALSE]
  s1 = w1  # shift register
  s2 = T1[] []  # shift register
  while (iteration -> i1) {
    Wait(time to wait=250)
    call "Get Tag.gviweb"(Host="cirrostratus") -> (Array=w2, Array_2=w3, Observed Data and Fitted Curve=w4)
    Is Greater(x=i1, y=10) -> w5
    case (w5) {
      frame True {
        w6 = s1
        w7 = s2
      }
      frame False {
        Replace Array Subset(inArray=s1, index=i1, new=TRUE) -> w6
        And Array Elements(Boolean array=w6) -> (logical AND=w8)
        $"Sequence Pass/Fail" <- w8
        Random Number() -> (number (0 to 1)=w9)
        Add(100, w9) -> w10
        Array Index(array=w2) -> (out0[i1]=w11)
        Array Index(array=w3) -> (out0[i1]=w12)
        Divide(x=w11, y=w12) -> w13
        Random Number() -> (number (0 to 1)=w14)
        Add(77, w14) -> w15
        Property Node(instance in=T1 {all zero or empty}, "Bandwidth (MHz)"=w10, "SNR"=w13, "Power Consumption %"=w15, "Step Pass?"=TRUE) -> (instance out=w16)
        Insert Into Array(inArray=s2, new=w16) -> w7
      }
    }
    $"Test Sequence Results" <- w7
    $"Observed Data and Fitted Curve" <- w4
    next s1 = w6
    next s2 = w7
    stop if FALSE
  }
